# Grasshopper definition ImportExport-CK05-MinimumPaths.gh (Grasshopper 0.9.76)
# plug-ins: Python Interpreter

panel = Panel("D:\Teaching\AAVisitingSchoolVienna\AAVisitingSchoolVienna-2017\3d")
concat = Concatenate(FragmentA=panel, FragmentC="\", FragmentB="AgentTrail_v2.txt")
in = ImportPoints(txt=concat)
panel_2 = Panel(in)
pline = PolyLine(Vertices=in, Closed=False)
python = PythonScript(polylines=flatten(pline))  # -> out, lines, count; inputs polylines: list; disabled
# ---------- python: Python ----------
import rhinoscriptsyntax as rs

lines=[]
count=[]

class Segment():
  def __init__(self, curve):
    self.curve=curve
    self.mid=rs.CurveMidPoint(curve)
    self.count=1

segments = [Segment(pl) for curve in rs.ExplodeCurves(polylines)]

for [s1,s2] in [[s1,s2] for s1 in segments for s2 in segments if s2<s1]:
  if rs.Distance(s1.mid,s2.mid)<0.01:
    s2.count += 1
    segments.remove(s1)

lines = [s.curve for s in segments]
count = [s.count for s in segments]
# ---------- end python ----------
crv_counter = CrvCounter(crv=pline)  # -> crv_4, int_3; disabled
multiplication = Multiplication(A=crv_counter.int_3, B=Slider(0.1, range=0..1))
pipe = Pipe(Curve=crv_counter.crv_4, Radius=multiplication, Caps=0)

# ==== cluster ImportPoints: Read a file, and import comma separated coordinates separated by '_'
txt = ClusterInput()
txt_2 = Text(txt)
file = ReadFile(File=txt_2, PerLineParse=True)  # -> simplify(graft(Content))
panel = Panel("-")
panel_2 = Panel("_")
split = TextSplit(Text=file, Separators=";")  # -> simplify(Result)
rep = ReplaceText(Text=split, Find=";", Replace=",", RecursiveReplace=False)
concat = Concatenate(FragmentA="{", FragmentB=split, FragmentC="}")
pt = Point(concat)
clean = CleanTree(RemoveNulls=True, RemoveInvalid=True, RemoveEmpty=True, Tree=pt)
panel_3 = Panel(clean)
pt_2 = Point(clean)
pt_3 = ClusterOutput(pt_2)

# ==== cluster CrvCounter
crv = ClusterInput()
crv_2 = Curve(crv)
explode = Explode(Curve=crv_2, Recursive=True)  # -> flatten(Segments), Vertices
curvepoint = PointOnCurve(explode.Segments, parameter=0.5)
sort_pt = SortPoints(Points=curvepoint)  # -> Points, Indices
item = ListItem(List=explode.Segments, Index=sort_pt.Indices, Wrap=False)
cullpt = CullDuplicates(Points=sort_pt.Points, Tolerance=0.1, CullMode=3)  # -> Points, Indices, Valence
crv_cp = CurveClosestPoint(Point=graft(cullpt.Points), Curve=item)  # -> Point, Parameter, Distance
lng = ListLength(List=crv_cp.Distance)
series = Series(Start=0, Step=1, Count=lng)
int = Integer(series)
sort = SortList(Keys=crv_cp.Distance, ValuesA=int)  # -> Keys, ValuesA
item_2 = ListItem(List=sort.ValuesA, Index=0, Wrap=True)
item_3 = ListItem(List=item, Index=item_2, Wrap=True)
int_2 = Integer(flatten(cullpt.Valence))
crv_3 = Curve(flatten(item_3))
crv_4 = ClusterOutput(crv_3)
int_3 = ClusterOutput(int_2)
