# Grasshopper definition MeshExporter-CK01.gh (Grasshopper 0.9.76)
# plug-ins: MeshEdit Components

mesh = Mesh(<mesh referenced from the Rhino model>)
mjoin = MeshJoin(Meshes=mesh)
weldvertices = MeshWeldVertices(Mesh=mjoin, Tolerance=0.01)  # -> RuntimeMessage, Mesh
demesh = DeconstructMesh(Mesh=weldvertices.Mesh)  # -> Vertices, Faces, Colours, Normals
pdecon = Deconstruct(Point=demesh.Vertices)  # -> XComponent, YComponent, ZComponent
expression = Expression(x=pdecon.ZComponent, Expression="sin(x/10)*255")
rgb = ColourRGB(Alpha=255, Red=expression, Green=expression, Blue=0)
conmesh = ConstructMesh(Vertices=demesh.Vertices, Faces=demesh.Faces, Colours=rgb)  # -> flatten(Mesh)
demesh_2 = DeconstructMesh(Mesh=conmesh)  # -> Vertices, Faces, Colours, Normals
argb = SplitARGB(Colour=demesh_2.Colours)  # -> Alpha, Red, Green, Blue
pdecon_2 = Deconstruct(Point=demesh_2.Vertices)  # -> XComponent, YComponent, ZComponent
pdecon_3 = Deconstruct(Point=demesh_2.Normals)  # -> XComponent, YComponent, ZComponent
expression_2 = Expression(x=pdecon_2.XComponent, Expression="int(x*1000)/1000")
expression_3 = Expression(x=pdecon_2.YComponent, Expression="int(x*1000)/1000")
expression_4 = Expression(x=pdecon_2.ZComponent, Expression="int(x*1000)/1000")
expression_5 = Expression(x=pdecon_3.XComponent, Expression="int(x*1000)/1000")
expression_6 = Expression(x=pdecon_3.YComponent, Expression="int(x*1000)/1000")
expression_7 = Expression(x=pdecon_3.ZComponent, Expression="int(x*1000)/1000")
split = TextSplit(Text=demesh_2.Faces, Separators="{}")
expression_8 = Expression(x=argb.Green, Expression="int(x*255)")
expression_9 = Expression(x=argb.Blue, Expression="int(x*255)")
expression_10 = Expression(x=argb.Red, Expression="int(x*255)")
item = ListItem(List=split, Index=1, Wrap=True)  # -> flatten(Item)
txt = Text(expression_2)
txt_2 = Text(expression_3)
txt_3 = Text(expression_4)
txt_4 = Text(expression_5)
txt_5 = Text(expression_6)
txt_6 = Text(expression_7)
txt_7 = Text(expression_10)
txt_8 = Text(expression_9)
txt_9 = Text(expression_8)
rep = ReplaceText(Text=item, Find=";", Replace=",", RecursiveReplace=False)
concat = Concatenate(FragmentA=txt, FragmentC=",", FragmentE=txt_2, FragmentD=",", FragmentB=txt_3, FragmentF=",")
concat_2 = Concatenate(FragmentA=txt_4, FragmentC=",", FragmentE=txt_5, FragmentD=",", FragmentB=txt_6, FragmentF=",")
concat_3 = Concatenate(FragmentA=txt_7, FragmentC=",", FragmentE=txt_9, FragmentD=",", FragmentB=txt_8, FragmentF=";")
concat_4 = Concatenate(FragmentA=rep, FragmentB=";")
mesh_2 = Mesh(graft(<mesh referenced from the Rhino model>))
concat_5 = Concatenate(FragmentA=concat, FragmentC=concat_2, FragmentE=concat_3)  # -> flatten(Result)
merge = Merge(Data1=concat_5, Data2="/", Data3=concat_4)
demesh_3 = DeconstructMesh(Mesh=mesh_2)  # -> Vertices, Faces, Colours, Normals
panel = Panel(merge)
txt_10 = Text(demesh_3.Colours)
preview = CustomPreview(
    Geometry=mesh_2,
    Shader={ambient=RGB(0, 0, 0), diffuse=RGB(255, 105, 180), emission=RGB(76, 32, 54), shine=0.5, specular=RGB(255, 255, 255), transparency=0})
split_2 = TextSplit(Text=txt_10, Separators="(")
item_2 = ListItem(List=split_2, Index=0, Wrap=True)
demesh_4 = DeconstructMesh(Mesh=mesh_2)  # -> Vertices, Faces, Colours, Normals
lng = ListLength(List=demesh_4.Vertices)
series = Series(Start=0, Step=1, Count=lng)
txt_11 = Text(demesh_4.Faces)
pdecon_4 = Deconstruct(Point=graft(demesh_4.Vertices))  # -> XComponent, YComponent, ZComponent
pdecon_5 = Deconstruct(Point=graft(demesh_4.Normals))  # -> XComponent, YComponent, ZComponent
split_3 = TextSplit(Text=txt_11, Separators=";")
int = Integer(graft(series))
split_4 = TextSplit(Text=split_3, Separators="{")
c_script = CSharpScript(mesh=mesh_2, i=int)  # -> out, A; inputs mesh: Mesh, i: Int32
# ---------- c_script: C# ----------
    A = mesh.Vertices.GetConnectedVertices(i);
# ---------- end c_script ----------
split_5 = TextSplit(Text=split_4, Separators="}")
lng_2 = ListLength(List=c_script.A)  # -> expr("x-1", Length)
pshift = ShiftPaths(Data=split_5, Offset=-2)
dup = DuplicateData(Data=",", Number=lng_2, Order=True)
cull_i = CullIndex(List=pshift, Indices=0, Wrap=True)
pshift_2 = ShiftPaths(Data=dup, Offset=-1)
data = Data(item_2)
merge_2 = Merge(Data1=graft(c_script.A), Data2=graft(pshift_2))
cull_i_2 = CullIndex(List=reverse(cull_i), Indices=0, Wrap=True)  # -> reverse(List)
trim = TextTrim(Text=data, Start=True, End=True)
pshift_3 = ShiftPaths(Data=merge_2, Offset=-2)
pshift_4 = ShiftPaths(Data=cull_i_2, Offset=-2)
lng_3 = ListLength(List=pshift_4)  # -> expr("x-1", Length)
nullrep = ReplaceNulls(Items=trim, Replacements="0,0,0")  # -> Items, Count
join = TextJoin(Text=pshift_3)
dup_2 = DuplicateData(Data=",", Number=lng_3, Order=True)
concat_6 = Concatenate(
    FragmentB=pdecon_4.XComponent,
    FragmentC=",",
    FragmentD=pdecon_4.YComponent,
    FragmentE=",",
    FragmentF=pdecon_4.ZComponent,
    FragmentG=",",
    FragmentH=pdecon_5.XComponent,
    FragmentI=",",
    FragmentJ=pdecon_5.YComponent,
    FragmentK=",",
    FragmentL=pdecon_5.ZComponent,
    FragmentP=",",
    FragmentM=int,
    FragmentN=",",
    FragmentO=join,
    FragmentA=",",
    FragmentR=nullrep.Items,
    FragmentQ=";")
pshift_5 = ShiftPaths(Data=dup_2, Offset=-1)
pshift_6 = ShiftPaths(Data=concat_6, Offset=-1)
item_3 = ListItem(List=pshift_6, Index=0, Wrap=True)
merge_3 = Merge(Data1=graft(pshift_4), Data2=graft(pshift_5))
replace = ReplaceItems(List=item_3, Item="/", Indices=0, Wrap=False)
pshift_7 = ShiftPaths(Data=replace, Offset=-1)
pshift_8 = ShiftPaths(Data=merge_3, Offset=-1)
join_2 = TextJoin(Text=pshift_8)
pshift_9 = ShiftPaths(Data=pshift_7, Offset=-1)
pshift_10 = ShiftPaths(Data=pshift_6, Offset=-1)
concat_7 = Concatenate(FragmentA=join_2, FragmentB=";")
pshift_11 = ShiftPaths(Data=concat_7, Offset=-1)
merge_4 = Merge(Data1=pshift_10, Data2=pshift_9, Data3=pshift_11)
panel_2 = Panel(merge_4)
