# Grasshopper definition Processing_NodalDisplacements.gh (Grasshopper 0.9.76)
# plug-ins: Karamba, Python Interpreter

c_script = CSharpScript()  # -> out, A
# ---------- c_script: C# ----------
    GH_Document gh_d = owner.OnPingDocument();

    if (gh_d.IsFilePathDefined)
    {
      Print("A path is defined.");
      A = gh_d.FilePath;
    }
    else
    {
      Print("No path defined.");
    }
# ---------- end c_script ----------
path_import = PathImport(T=c_script.A)
panel = Panel(path_import)
file = ReadFile(File=path_import, PerLineParse=True)
item = ListItem(List=file, Index=0, Wrap=True)
shift = ShiftList(List=file, Shift=1, Wrap=False)
split = SplitList(List=shift, Index=item)  # -> ListA, ListB
split_2 = TextSplit(Text=split.ListB, Separators="_")
panel_2 = Panel(split.ListA)
item_2 = ListItem(List=split_2, Index=0, Wrap=True)  # -> Item, Item1
pt = Point(split.ListA)

# ---- group: SUPPORT
pdecon = Deconstruct(Point=pt)  # -> XComponent, YComponent, ZComponent
smaller = SmallerThan(FirstNumber=pdecon.ZComponent, SecondNumber=Slider(1.4, range=0..10))  # -> SmallerThan, OrEqualTo
cull = CullPattern(List=pt, CullPattern=smaller.SmallerThan)
supp = SupportKaramba(PosInd=cull, menu=[buttons(on, on, on, on, on, on)])

# ----
matselect = MaterialSelectionKaramba(menu=[dropdown(1), dropdown(2)])
cross_sections = CrossSectionsKaramba(
    Height_cm=9.6,
    UpperFlangeWidth_cm=10,
    LowerFlangeWidth_cm=10,
    UpperFlangeThickness_cm=0.8,
    LowerFlangeThickness_cm=0.8,
    WebThickness_cm=0.5,
    FilletRadius_cm=0,
    mode="I")
loads = LoadsKaramba(Vector=Vector(0, 0, -1), LCase=0, mode="Gravity")
indtobeam = IndexToBeamKaramba(IndexA=item_2.Item, IndexB=item_2.Item1)  # -> flatten(Element)
license = LicenseKaramba()
assemble = AssembleModelKaramba3D(
    Point=pt,
    Elem=indtobeam,
    Support=supp,
    Load=loads,
    CrossSection=cross_sections,
    Material=matselect,
    LimitDistance_m=5e-06)  # -> Model, Info, Mass_kg, CenterOfGravity
assemble_2 = AssembleModelKaramba(LimitDistance_m=5e-05)  # -> Model, Info, Mass_kg, CenterOfGravity
analyzenonlin = AnalysisNonlinearKaramba(
    Model=assemble.Model,
    NumberOfLoadSteps=1,
    MaxNumberOfEquilibriumIterations=50,
    EquilibriumTolerance=1e-07,
    mode="ArcLength")  # -> CalculatedModel, MaximumDisplacement_m, ElasticEnergy_kNm, Info
analyzethi = AnalyzeThIKaramba(Model=assemble.Model)  # -> CalculatedModel, MaximumDisplacement_m, ResultingForceOfGravity_kN, ElasticEnergy_kNm
nodedisp = NodalDisplacementsKaramba(AnalyzedModel=analyzethi.CalculatedModel)  # -> AnalyzedModel, NodalTranslations_m, NodalRotations_rad
devec = DeconstructVector(Vector=nodedisp.NodalTranslations_m)  # -> XComponent, YComponent, ZComponent
expression = Expression(x=devec.XComponent, Expression="round(x,5)")
expression_2 = Expression(x=devec.YComponent, Expression="round(x,5)")
expression_3 = Expression(x=devec.ZComponent, Expression="round(x,5)")
pt_2 = ConstructPoint(XCoordinate=0, YCoordinate=0, ZCoordinate=0)
item_3 = ListItem(List=nodedisp.NodalTranslations_m, Index=0, Wrap=True)
vec = VectorXYZ(XComponent=expression, YComponent=expression_2, ZComponent=expression_3)  # -> Vector, Length
dup = DuplicateData(Data=pt_2, Number=item, Order=True)  # -> flatten(Data)
panel_3 = Panel(item_3)
null = NullItem(Item=item_3)  # -> NullFlags, InvalidFlags, Description
filter = StreamFilter(Gate=null.NullFlags, Stream0=vec.Vector, Stream1=dup)
c_script_2 = CSharpScript()  # -> out, A; same code as c_script
rep = ReplaceText(Text=filter, Find="{", RecursiveReplace=False)
path_export = PathExport(T=c_script_2.A)
rep_2 = ReplaceText(Text=rep, Find="}", RecursiveReplace=False)
python = PythonScript(data=rep_2, path=path_export)  # inputs data: list
# ---------- python: Python ----------
f = open(path, 'w')
for line in data:
    f.write(line+'\n')
f.close()
# ---------- end python ----------
panel_4 = Panel(path_export)
panel_5 = Panel(rep_2)

# ==== cluster PathImport
T = ClusterInput()
split = TextSplit(Text=T, Separators="\")
shift = ShiftList(List=split, Shift=-1, Wrap=False)
concat = Concatenate(FragmentA=shift, FragmentB="\")
join = TextJoin(Text=concat)
concat_2 = Concatenate(FragmentA=join, FragmentB="Processing_Karamba.txt")
R = ClusterOutput(concat_2)

# ==== cluster PathExport
T = ClusterInput()
split = TextSplit(Text=T, Separators="\")
shift = ShiftList(List=split, Shift=-1, Wrap=False)
concat = Concatenate(FragmentA=shift, FragmentB="\")
join = TextJoin(Text=concat)
concat_2 = Concatenate(FragmentA=join, FragmentB="Karamba_Processing.txt")
R = ClusterOutput(concat_2)
